# Grasshopper definition task_1_m3.gh (Grasshopper 1.0.8)

curve = Curve([<curve referenced from the Rhino model> x2])
loft = Loft(Curves=curve, Options={Adjust=False, Closed=False, LoftEnds=0, LoftSimp=0, LoftType=0, Rebuild=10, Refit=0.01})
contour = Contour(Shape=loft, Point=Point(0, 0, 0), Direction=Vector(0, 0, 1), Distance=Slider(0.187, range=0..3))
vector_xyz = VectorXYZ(XComponent=Slider(0, range=0..10), YComponent=Slider(2, range=0..10), ZComponent=0)  # -> Vector, Length
extrude = Extrude(Base=contour, Direction=vector_xyz.Vector)
vector_xyz_2 = VectorXYZ(XComponent=Slider(0, range=0..10), YComponent=Slider(0, range=0..10), ZComponent=Slider(1, range=0..10))  # -> Vector, Length
extrude_2 = Extrude(Base=extrude, Direction=vector_xyz_2.Vector)
